# Dynamo graph Direct Shape Python test1.dyn (Dynamo 1.3.0.875)

select_model_elements = DSModelElementsSelection()  # 4 picked in the model
geometry = Element.Geometry(select_model_elements)
flatten = Flatten(geometry)
byJoinedCurves = PolyCurve.ByJoinedCurves(flatten)
select_model_elements_2 = DSModelElementsSelection()  # 4 picked in the model
geometry_2 = Element.Geometry(select_model_elements_2)
flatten_2 = Flatten(geometry_2)
byJoinedCurves_2 = PolyCurve.ByJoinedCurves(flatten_2)
select_model_elements_3 = DSModelElementsSelection()  # 4 picked in the model
geometry_3 = Element.Geometry(select_model_elements_3)
flatten_3 = Flatten(geometry_3)
byJoinedCurves_3 = PolyCurve.ByJoinedCurves(flatten_3)
join = List.Join(byJoinedCurves, byJoinedCurves_2, byJoinedCurves_3)
code_block = CodeBlock { -5; }
extrudeAsSolid = Curve.ExtrudeAsSolid(join, code_block)
categories = Categories("GenericModel")
python_script = Python(IN[0]=extrudeAsSolid, IN[1]=categories)
# ---------- python_script.python (72 lines) ----------
import clr
clr.AddReference('ProtoGeometry')
from Autodesk.DesignScript.Geometry import *

clr.AddReference('RevitAPI')
clr.AddReference('RevitAPIUI')
from Autodesk.Revit.DB import *
from Autodesk.Revit import DB
from Autodesk.Revit.UI import *

clr.AddReference('RevitServices')
from RevitServices.Persistence import DocumentManager
from RevitServices.Transactions import TransactionManager

clr.AddReference("RevitNodes")
import Revit
clr.ImportExtensions(Revit.Elements)
clr.ImportExtensions(Revit.GeometryConversion)

clr.AddReference('System')
from System.Collections.Generic import List
#The inputs to this node will be stored as a list in the IN variables.
dataEnteringNode = IN

doc = DocumentManager.Instance.CurrentDBDocument

solid = IN[0]
category = UnwrapElement(IN[1])
solidList = []
solidIds = []
catId = category.Id

TransactionManager.Instance.EnsureInTransaction(doc)

for i in range(len(solid)):
	ds = DirectShape.CreateElement(doc, catId)
	ds.SetShape(solid[i].ToRevitType())
	ds.Name = "This is the Name"
	solidList.append(ds)
	solidIds.append(ds.Id)

TransactionManager.Instance.ForceCloseTransaction()

fileLoc = "C:/Users/Sibi Chakkaravarthy/Documents/Revi"
fileName = "sibi"
fileName1 = "sibi1.fbx"

#doc = __revit__.ActiveUIDocument.Document

doc1 = DocumentManager.Instance.CurrentDBDocument
#uidoc1 = DocumentManager.Instance.CurrentUIApplication.ActiveUIDocument

export_ops = DB.FBXExportOptions()
views = DB.ViewSet()
# view must be a 3D view
views.Insert(DocumentManager.Instance.CurrentUIApplication.ActiveUIDocument.ActiveGraphicalView)
#__revit__.ActiveUIDocument.ActiveGraphicalView

doc1.Export(fileLoc, fileName1, views, export_ops)

navOp = NavisworksExportOptions()
col1 = List[ElementId](solidIds)
navOp.SetSelectedElementIds(col1)
navOp.ExportScope = navOp.ExportScope.SelectedElements
navOp.ExportRoomGeometry = False
doc.Export(fileLoc, fileName, navOp)

TransactionManager.Instance.EnsureInTransaction(doc)
TransactionManager.Instance.TransactionTaskDone()

#Assign your output to the OUT variable.
OUT = solidIds
# ----------------------------------------
current = Document.Current()
filePath = Document.FilePath(current)
code_block_2 = CodeBlock {  }
code_block_3 = CodeBlock {  }
